# Grasshopper definition Webcam to g-code for CNC mill and Laser - grasshopper.gh (Grasshopper 0.9.76)
# plug-ins: Firefly.X

edge_margin = Slider(14, range=0..100)
cut_depth = Slider(8, range=0..20)
position_x = Slider(65, range=0..100)
position_y = Slider(58, range=0..100)
halftone_threshold_level = Slider(0.632, range=0..1)
video_stream = WebCamVideoStream()
curve_length_filter = Slider(40, range=0..100)
record_image = Button()
cut_depth_2 = Panel(cut_depth)
cracker_size_x = Panel("76")
edge_margin_2 = Panel(edge_margin)
position_x_2 = Panel(position_x)
position_y_2 = Panel(position_y)
cracker_size_y = Panel("56")

# ---- group: Record webcam image
filter = StreamFilter(Gate=record_image, Stream0="now", Stream1="now")
time = Time(filter)
panel = Panel(time)
rep = ReplaceText(Text=panel, Find=",", RecursiveReplace=False)
rep_2 = ReplaceText(Text=rep, Find=":", Replace="-", RecursiveReplace=False)
rep_3 = ReplaceText(Text=rep_2, Find=":", Replace="-", RecursiveReplace=False)
rep_4 = ReplaceText(Text=rep_3, Find="(", RecursiveReplace=False)
rep_5 = ReplaceText(Text=rep_4, Find=")", RecursiveReplace=False)
panel_2 = Panel(rep_5)
panel_3 = Panel(panel_2)
join = TextJoin(Text=[panel_3, ".png"])
sequence = SnapshotSequence(
    BitmapToModify=video_stream,
    NumberOfSnapshotsToRecord=10,
    TimeIntervalMillisecondsBetweenRecordings=200,
    FileDirectory="C:\Users\Jens\Desktop\Petit handshake\",
    FileName=join,
    ImageType=2,
    Start=record_image)

# ---- group: Extract vecor silouettes from webcam bitmap
multiplication = Multiplication(A="40", B="0.75")
contrast = Contrast(BitmapToModify=video_stream, ContrastMultiplier=Slider(0.572, range=0..1))
dom = ConstructDomain(DomainStart="0", DomainEnd="40")
dom_2 = ConstructDomain(DomainStart="0", DomainEnd=multiplication)
multiplication_2 = Multiplication(A="5", B=halftone_threshold_level)
mesh = MeshFromImage(Bmp=contrast, Sx=dom, Sy=dom_2, Z="0", C=False)
mesh_2 = MeshFromImage(Bmp=contrast, Sx=dom, Sy=dom_2, Z="5", C=False)
multiplication_3 = Multiplication(A=multiplication_2, B=Slider(2, range=0..10))
pt = ConstructPoint(XCoordinate=0, YCoordinate=0, ZCoordinate=multiplication_3)
xy = XYPlane(Origin=pt)
sec = MeshPlane(Mesh=mesh_2, Plane=xy)
len = Length(Curve=sec)
sort = SortList(Keys=len, ValuesA=sec)  # -> Keys, ValuesA
rev = ReverseList(List=sort.ValuesA)
item = ListItem(List=rev, Index="0", Wrap=True)

# ----
multiplication_4 = Multiplication(A=edge_margin_2, B="2")
pt_2 = ConstructPoint(XCoordinate=position_x_2, YCoordinate=position_y_2, ZCoordinate=0)
subtraction = Subtraction(A=cracker_size_y, B=multiplication_4)
xy_2 = XYPlane(Origin=pt_2)
multiplication_5 = Multiplication(A=cracker_size_y, B="0.5")
Y = UnitY(Factor=multiplication_5)
multiplication_6 = Multiplication(A=cracker_size_x, B="0.5")
rectangle = Rectangle(Plane=xy_2, XSize=cracker_size_x, YSize=cracker_size_y, Radius=0)  # -> Rectangle, Length
move = Move(Geometry=pt_2, Motion=Y)  # -> Geometry, Transform
X = UnitX(Factor=multiplication_6)
move_2 = Move(Geometry=move.Geometry, Motion=X)  # -> Geometry, Transform

multiplication_7 = Multiplication(A=edge_margin_2, B="2")
subtraction_2 = Subtraction(A=cracker_size_x, B=multiplication_7)
cracker_outline = Curve(rectangle.Rectangle)
demo_hands = Curve([<curve referenced from the Rhino model> x2])
smaller = SmallerThan(FirstNumber=sort.Keys, SecondNumber=curve_length_filter)  # -> SmallerThan, OrEqualTo
dispatch = Dispatch(List=sort.ValuesA, DispatchPattern=smaller.OrEqualTo)  # -> ListA, ListB
webcam_hands = Curve(dispatch.ListB)
cut_depth_3 = Panel(cut_depth_2)
neg = Negative(Value=cut_depth_3)
Z = UnitZ(Factor=neg)
crv = Curve(<curve referenced from the Rhino model>)
crv_2 = Curve([<curve referenced from the Rhino model> x2])
_3d_curves_for_toolpath = Curve(crv_2)
emblaser_engraving = Panel("FABtotum milling")
laser_strength = Number(Slider(127, range=0..1000))
jog_rate_x_y = Number(Slider(1000, range=0..3000))
toolpaths = Curve(_3d_curves_for_toolpath)  # disabled
feed_rate = Number(Slider(500, range=0..1000))
resample_curve = Integer(Toggle(True))
sample_tolerance_in_mm = Number(Slider(0.02, range=0.02..0.1))
home_y = Number(Slider(0, range=0..1000))
safe_z_height = Number(Slider(8, range=0..20))
home_x = Number(Slider(0, range=0..1000))
topoly = CurveToPolyline(Curve=toolpaths, ToleranceDistance=sample_tolerance_in_mm, ToleranceAngle=0)  # -> Polyline, Segments
filter_2 = StreamFilter(Gate=resample_curve, Stream0=toolpaths, Stream1=topoly.Polyline)
cp = ControlPoints(Curve=filter_2)  # -> Points, Weights, Knots
rev_2 = ReverseList(List=cp.Points)
safe_z_height_2 = Number(safe_z_height)
item_2 = ListItem(List=cp.Points, Index=0, Wrap=True)
item_3 = ListItem(List=rev_2, Index=0, Wrap=True)
pdecon = Deconstruct(Point=item_2)  # -> XComponent, YComponent, ZComponent
pdecon_2 = Deconstruct(Point=item_3)  # -> XComponent, YComponent, ZComponent
pt_3 = ConstructPoint(XCoordinate=pdecon.XComponent, YCoordinate=pdecon.YComponent, ZCoordinate=safe_z_height_2)
pt_4 = ConstructPoint(XCoordinate=pdecon_2.XComponent, YCoordinate=pdecon_2.YComponent, ZCoordinate=safe_z_height_2)
toolpath_points = Point(cp.Points)
safe_z_end_point = Point(pt_4)
safe_z_start_point = Point(pt_3)
toolpath_points_2 = Point(flatten(cp.Points))
flatten = FlattenTree(Tree=toolpath_points, Path="{0}")
rev_3 = ReverseList(List=flatten(safe_z_end_point))
lng = ListLength(List=flatten)
route_previvew_position = Number(Slider(0, range=0..1))
cull_i = CullIndex(List=flatten(safe_z_start_point), Indices=0, Wrap=True)
lng_2 = ListLength(List=toolpath_points_2)
cull_i_2 = CullIndex(List=rev_3, Indices=0, Wrap=True)
rev_4 = ReverseList(List=flatten(cull_i_2))
number_slider = Slider(3, range=0..10)
number_of_code_preview_lines = Slider(39, range=0..100)
code_preview_angle = Slider(90, range=0..100)
code_preview_font_size = Slider(3, range=0..100)
multiplication_8 = Multiplication(A=lng_2, B=route_previvew_position)
line_spacing_factor = Slider(1.45, range=1..2.5)
ln = Line(StartPoint=safe_z_start_point, EndPoint=item_2)
ln_2 = Line(StartPoint=rev_4, EndPoint=cull_i)
ln_3 = Line(StartPoint=item_3, EndPoint=safe_z_end_point)
lng_3 = ListLength(List=toolpath_points)
item_4 = ListItem(List=toolpath_points_2, Index=multiplication_8, Wrap=True)
toolpath_preview_line = Curve(filter_2)
cut_transition_preview_line = Curve(ln_2)
cut_entry_preview_line = Curve(ln)
cut_exit_preview_line = Curve(ln_3)
material = CreateMaterial(
    Diffuse=ColourSwatch(SwatchColor=RGB(130, 249, 255)),
    Specular=RGB(255, 255, 255),
    Emission=RGB(0, 0, 0),
    Transparency=0,
    Shine=0)
material_2 = CreateMaterial(
    Diffuse=ColourSwatch(SwatchColor=RGB(99, 74, 16)),
    Specular=RGB(255, 255, 255),
    Emission=RGB(0, 0, 0),
    Transparency=0,
    Shine=0)
material_3 = CreateMaterial(
    Diffuse=ColourSwatch(SwatchColor=RGB(174, 234, 235)),
    Specular=RGB(255, 255, 255),
    Emission=RGB(0, 0, 0),
    Transparency=0,
    Shine=0)
material_4 = CreateMaterial(
    Diffuse=ColourSwatch(SwatchColor=RGB(77, 114, 115)),
    Specular=RGB(255, 255, 255),
    Emission=RGB(0, 0, 0),
    Transparency=0,
    Shine=0)
sph = Sphere(Base=item_4, Radius=Slider(0.8, range=0..10))
pt_5 = ConstructPoint(XCoordinate=Slider(66, range=0..1000), YCoordinate=Slider(-8, range=-1000..1000), ZCoordinate=0)
multiplication_9 = Multiplication(A=code_preview_font_size, B=line_spacing_factor)
Y_2 = UnitY(Factor=1)
preview = CustomPreview(Geometry=toolpath_preview_line, Shader=material)
preview_2 = CustomPreview(Geometry=cut_transition_preview_line, Shader=material_2)
pdecon_3 = Deconstruct(Point=toolpath_points)  # -> XComponent, YComponent, ZComponent
preview_3 = CustomPreview(Geometry=cut_entry_preview_line, Shader=material_3)
preview_4 = CustomPreview(Geometry=cut_exit_preview_line, Shader=material_4)
series = Series(Start=0, Step=multiplication_9, Count=number_of_code_preview_lines)
rev_5 = Reverse(Vector=Y_2)
Z_2 = UnitZ(Factor=1)
neg_2 = Negative(Value=series)
pl = ConstructPlane(Origin=pt_5, XAxis=rev_5, YAxis=Z_2)
series_2 = Series(Start=0, Step=Slider(1, range=0..1), Count=number_of_code_preview_lines)
dup = DuplicateData(Data=code_preview_font_size, Number=number_of_code_preview_lines, Order=True)
panel_4 = Panel(pdecon_3.XComponent)
panel_5 = Panel(pdecon_3.YComponent)
division = Division(A=series_2, B=number_of_code_preview_lines)

item_5 = ListItem(List=pdecon_3.XComponent, Index=0, Wrap=True)
item_6 = ListItem(List=pdecon_3.YComponent, Index=0, Wrap=True)
lng_4 = ListLength(List=flatten(item_5))
dup_2 = DuplicateData(Data="G00 X", Number=lng_4, Order=True)
dup_3 = DuplicateData(Data=" Y", Number=lng_4, Order=True)
dup_4 = DuplicateData(Data=" Z", Number=lng_4, Order=True)
simplify = SimplifyTree(Tree=flatten(dup_2), Front=False)
simplify_2 = SimplifyTree(Tree=flatten(item_5), Front=False)
simplify_3 = SimplifyTree(Tree=flatten(dup_3), Front=False)
simplify_4 = SimplifyTree(Tree=flatten(item_6), Front=False)
simplify_5 = SimplifyTree(Tree=flatten(dup_4), Front=False)
graft = GraftTree(Tree=simplify, IncludeEmptyLists=True, IncludeNullItems=True)
graft_2 = GraftTree(Tree=simplify_2, IncludeEmptyLists=True, IncludeNullItems=True)
graft_3 = GraftTree(Tree=simplify_3, IncludeEmptyLists=True, IncludeNullItems=True)
graft_4 = GraftTree(Tree=simplify_4, IncludeEmptyLists=True, IncludeNullItems=True)
graft_5 = GraftTree(Tree=simplify_5, IncludeEmptyLists=True, IncludeNullItems=True)
join_2 = TextJoin(Text=[graft, graft_2, graft_3, graft_4])
flatten_2 = FlattenTree(Tree=join_2, Path="{0}")
home_x_2 = Number(home_x)
home_y_2 = Number(home_y)
join_3 = TextJoin(Text=["G00 X", home_x_2, " Y", home_y_2])
merge = Merge(Data1=flatten(flatten_2), Data2=flatten(join_3))
jog_x_y_positions = Panel(merge)

neg_3 = Negative(Value=code_preview_angle)
xz = XZPlane(Origin=pt_5)
rev_6 = ReverseList(List=division)
rotate = Rotate(Geometry=pl, Angle=degrees(neg_3), Plane=xz)  # -> Geometry, Transform
num = Number(rev_6)
argb = SplitARGB(Colour=ColourSwatch(SwatchColor=RGB(130, 232, 255)), IntegerChannels=True)  # -> Alpha, Red, Green, Blue
deplane = DeconstructPlane(Plane=rotate.Geometry)  # -> Origin, XAxis, YAxis, ZAxis
dup_5 = DuplicateData(Data=" X", Number=lng_3, Order=True)
dup_6 = DuplicateData(Data=" Y", Number=lng_3, Order=True)
dup_7 = DuplicateData(Data="G1 ", Number=lng_3, Order=True)
amp = Amplitude(Vector=deplane.YAxis, Amplitude=neg_2)
simplify_6 = SimplifyTree(Tree=flatten(dup_5), Front=False)
simplify_7 = SimplifyTree(Tree=flatten(dup_7), Front=False)
simplify_8 = SimplifyTree(Tree=flatten(panel_4), Front=False)
simplify_9 = SimplifyTree(Tree=flatten(dup_6), Front=False)
simplify_10 = SimplifyTree(Tree=flatten(panel_5), Front=False)
move_3 = Move(Geometry=rotate.Geometry, Motion=amp)  # -> Geometry, Transform
xy_3 = XYPlane(Origin=move_2.Geometry)
graft_6 = GraftTree(Tree=simplify_7, IncludeEmptyLists=True, IncludeNullItems=True)
graft_7 = GraftTree(Tree=simplify_8, IncludeEmptyLists=True, IncludeNullItems=True)
graft_8 = GraftTree(Tree=simplify_9, IncludeEmptyLists=True, IncludeNullItems=True)
graft_9 = GraftTree(Tree=simplify_10, IncludeEmptyLists=True, IncludeNullItems=True)
graft_10 = GraftTree(Tree=simplify_6, IncludeEmptyLists=True, IncludeNullItems=True)
multiplication_10 = Multiplication(A=argb.Red, B=num)
multiplication_11 = Multiplication(A=argb.Blue, B=num)
multiplication_12 = Multiplication(A=argb.Green, B=num)
rgb = ColourRGB(Alpha=255, Red=multiplication_10, Green=multiplication_12, Blue=multiplication_11)
join_4 = TextJoin(Text=[graft_6, graft_10, graft_7, graft_8, graft_9])

lng_5 = ListLength(List=merge)
dup_8 = DuplicateData(Data="M5", Number=lng_5, Order=True)
flatten_3 = FlattenTree(Tree=dup_8, Path="{0}")
laser_off = Panel(flatten_3)

laser_strength_2 = Number(laser_strength)
int = Integer(laser_strength_2)
join_5 = TextJoin(Text=["M3 S", int])
lng_6 = ListLength(List=merge)
dup_9 = DuplicateData(Data=join_5, Number=lng_6, Order=True)
flatten_4 = FlattenTree(Tree=dup_9, Path="{0}")
rev_7 = ReverseList(List=flatten_4)
replace = ReplaceItems(List=flatten(rev_7), Item="M5", Indices="0", Wrap=False)
rev_8 = ReverseList(List=flatten(replace))
laser_on_and_strength = Panel(rev_8)

flatten_5 = FlattenTree(Tree=join_4, Path="{0}")
feed_rate_2 = Number(feed_rate)

join_6 = TextJoin(Text=["G1 ", "F", feed_rate_2])
lng_7 = ListLength(List=merge)
dup_10 = DuplicateData(Data=join_6, Number=lng_7, Order=True)
flatten_6 = FlattenTree(Tree=dup_10, Path="{0}")
feedrates = Panel(flatten_6)

panel_6 = Panel(flatten_5)

ma = MassAddition(Input=flatten(lng_3))  # -> Result, PartialResults
merge_2 = Merge(Data1=Slider(0, range=0..100), Data2=ma.PartialResults)
ins = InsertItems(List=flatten(panel_6), Item=flatten(laser_off), Indices=flatten(merge_2), Wrap=True)

lng_8 = ListLength(List=merge_2)
series_3 = Series(Start=1, Step=1, Count=lng_8)
addition = Addition(A=merge_2, B=series_3)
ins_2 = InsertItems(List=flatten(ins), Item=flatten(jog_x_y_positions), Indices=flatten(addition), Wrap=True)

# ----
# Startcode: ;enter suitable start code for your machine here
# Startcode - Ultimaker original , extruder upgrade + heatbed: M190 S70.000000
# M109 T0 S220.000000
# T0
# G21        ;metric values
# G90        ;absolute positioning
# M82        ;set extruder to absolute mode
# M107       ;start with the fan off
# G28 X0 Y0  ;move X/Y to min endstops
# G28 Z0     ;move Z to min endstops
# G1 Z15.0 F9000 ;move the platform down 15mm
# G92 E0                  ;zero the extruded length
# G1 F200 E17              ;extrude 17mm of feed stock
# G92 E0                  ;zero the extruded length again
# G1 F9000
# ;Put printing message on LCD screen
# M117 Bark beetle
# Startcode - Printrbot Simple: M190 S30.000000
# M109 S220.000000
# ;Sliced at: Mon 16-03-2015 21:37:50
# ;Basic settings: Layer height: 0.2 Walls: 0.8 Fill: 20
# ;Print time: 3 minutes
# ;Filament used: 0.151m 0.0g
# ;Filament cost: None
# ;M190 S30 ;Uncomment to add your own bed temperature line
# ;M109 S220 ;Uncomment to add your own temperature line
# G21        ;metric values
# G90        ;absolute positioning
# M82        ;set extruder to absolute mode
# M107       ;start with the fan off
# 
# G28 X0 Y0  ;move X/Y to min endstops
# G28 Z0     ;move Z to min endstops
# 
# G1 Z15.0 F9000 ;move the platform down 15mm
# 
# G92 E0                  ;zero the extruded length
# G1 F200 E6              ;extrude 6mm of feed stock
# G92 E0                  ;zero the extruded length again
# G1 F9000
startcode_fabtotum = Panel("""G90        ;absolute positioning

;G28	;Home all Axis

M3 S15000 ;SPINDLE ON - Clockwise , tries to maintain RPM constant min: 6500, max: 15000
G4 S4; Dwell 4 seconds

G0 F600 Z-210; move to custom Z 0 position
G92 Z0; set new zero position""")
# Endcode: ;enter suitable end code for your machine here
# Endcode - Ultimaker original , extruder upgrade + heatbed: ;End GCode
# M104 S0                     ;extruder heater off
# M140 S0                     ;heated bed heater off (if you have it)
# G91                                    ;relative positioning
# G1 E-1 F300                            ;retract the filament a bit before lifting the nozzle, to release some of the pressure
# G1 Z+0.5 E-5 X-20 Y-20 F9000 ;move Z up a bit and retract filament even more
# G28 X0 Y0                              ;move X/Y to min endstops, so the head is out of the way
# M84                         ;steppers off
# G90                         ;absolute positioning
# Endcode - Printrbot Simple: M104 S0                     ;extruder heater off
# M140 S0                     ;heated bed heater off (if you have it)
# 
# G91                                    ;relative positioning
# G1 E-1 F300                            ;retract the filament a bit before lifting the nozzle, to release some of the pressure
# G1 Z+0.5 E-5 X-20 Y-20 F9000 ;move Z up a bit and retract filament even more
# G28 X0 Y0                              ;move X/Y to min endstops, so the head is out of the way
# 
# M84                         ;steppers off
# G90                         ;absolute positioning
endcode_fabtotum = Panel("""G4 S2; Dwell
M5; SPINDLE OFF""")

lng_9 = ListLength(List=merge_2)
series_4 = Series(Start=1, Step=1, Count=lng_9)
addition_2 = Addition(A=addition, B=series_4)
ins_3 = InsertItems(List=flatten(ins_2), Item=flatten(laser_on_and_strength), Indices=flatten(addition_2), Wrap=True)

lng_10 = ListLength(List=merge_2)
series_5 = Series(Start=1, Step=1, Count=lng_10)
addition_3 = Addition(A=addition_2, B=series_5)
ins_4 = InsertItems(List=flatten(ins_3), Item=flatten(feedrates), Indices=flatten(addition_3), Wrap=True)

# ----
# Startcode: ;enter suitable start code for your machine here
# Startcode - FABtotum: G90        ;absolute positioning
# ;G28	;Home all Axis
# ;G1 Z15.0 F9000 ;move the platform down 15mm
# G0 F600 Z-190; move to custom Z 0 position
# G92 Z0; set new zero position
# 
# 
# M3 S15000 ;SPINDLE ON - Clockwise , tries to maintain RPM constant min: 6500, max: 15000
# G4 S2; Dwell
startcode_emblaser = Panel("G21")
# Endcode: ;enter suitable end code for your machine here
endcode_emblaser = Panel("G28")
endcode_fabtotum_2 = Panel("""G4 S2; Dwell
M5; SPINDLE OFF""")
merge_3 = Merge(Data1=flatten(startcode_emblaser), Data2=flatten(ins_4), Data3=flatten(endcode_emblaser))
split = SplitList(List=merge_3, Index=number_of_code_preview_lines)  # -> ListA, ListB
tag = TextTag3D(Location=move_3.Geometry, Text=split.ListA, Size=dup, Colour=rgb, Justification=1)
panel_7 = Panel(merge_3)
number_slider_2 = Slider(10, range=0..10)
lng_11 = ListLength(List=panel_7)
dup_11 = DuplicateData(Data=" ", Number=lng_11, Order=True)
series_6 = Series(Start=number_slider_2, Step=number_slider_2, Count=lng_11)
dup_12 = DuplicateData(Data="N", Number=lng_11, Order=True)
int_2 = Integer(series_6)
flatten_7 = FlattenTree(Tree=dup_11, Path="{0}")
flatten_8 = FlattenTree(Tree=dup_12, Path="{0}")
flatten_9 = FlattenTree(Tree=panel_7, Path="{0}")
flatten_10 = FlattenTree(Tree=int_2, Path="{0}")
graft_11 = GraftTree(Tree=flatten_7, IncludeEmptyLists=True, IncludeNullItems=True)
graft_12 = GraftTree(Tree=flatten_8, IncludeEmptyLists=True, IncludeNullItems=True)
graft_13 = GraftTree(Tree=flatten_9, IncludeEmptyLists=True, IncludeNullItems=True)
graft_14 = GraftTree(Tree=flatten_10, IncludeEmptyLists=True, IncludeNullItems=True)
join_7 = TextJoin(Text=[graft_12, graft_14, graft_11, graft_13])
flatten_11 = FlattenTree(Tree=join_7, Path="{0}")
panel_8 = Panel(flatten_11)

crv_3 = Curve(webcam_hands)
xy_4 = XYPlane(Origin=Point(0, 0, 0))
project = Project(Geometry=crv_3, Plane=xy_4)  # -> Geometry, Transform
bbox = BoundingBox(Content=project.Geometry, Plane=PlaneXY(0, 0, 0), UnionBox=True)  # -> Box, Box_2
edges = BrepEdges(Brep=bbox.Box)  # -> Naked, Interior, NonManifold
item_7 = ListItem(List=edges.Naked, Index=1, Wrap=True)
item_8 = ListItem(List=edges.Naked, Index=0, Wrap=True)
len_2 = Length(Curve=item_7)
len_3 = Length(Curve=item_8)
panel_9 = Panel(len_3)
panel_10 = Panel(len_2)
larger = LargerThan(FirstNumber=panel_9, SecondNumber=panel_10)  # -> LargerThan, OrEqualTo
filter_3 = StreamFilter(Gate=larger.LargerThan, Stream0=panel_10, Stream1=panel_9)
area = Area(Geometry=bbox.Box)  # -> Area, Centroid
division_2 = Division(A=subtraction, B=filter_3)
vec2pt = Vector2Pt(PointA=area.Centroid, PointB=move_2.Geometry, Unitize=False)  # -> Vector, Length

division_3 = Division(A=subtraction_2, B=filter_3)
filter_4 = StreamFilter(Gate=larger.LargerThan, Stream0=division_2, Stream1=division_3)

scale = Scale(Geometry=project.Geometry, Center=area.Centroid, Factor=filter_4)  # -> Geometry, Transform
move_4 = Move(Geometry=scale.Geometry, Motion=vec2pt.Vector)  # -> Geometry, Transform

finsihed_hands = Curve(flatten(move_4.Geometry))
move_5 = Move(Geometry=finsihed_hands, Motion=Z)  # -> Geometry, Transform

preview_position = Slider(0, range=0..1)
crv_4 = Curve(move_5.Geometry)
_3d_curves_for_toolpath_2 = Curve(crv_4)
toolpaths_2 = Curve(flatten(_3d_curves_for_toolpath_2))
safe_z_height_3 = Number(Slider(12, range=0..20))
jog_rate_z = Number(Slider(1000, range=0..1000))
jog_rate_x_y_2 = Number(Slider(3000, range=0..3000))
feed_rate_3 = Number(Slider(400, range=0..1000))
plunge_rate = Number(Slider(600, range=0..1000))
resample_curve_2 = Integer(Toggle(True))
sample_tolerance_in_mm_2 = Number(Slider(0.02, range=0.02..0.1))
home_y_3 = Number(Slider(0, range=0..1000))
home_x_3 = Number(Slider(0, range=0..1000))

topoly_2 = CurveToPolyline(Curve=toolpaths_2, ToleranceDistance=sample_tolerance_in_mm_2, ToleranceAngle=0)  # -> Polyline, Segments
filter_5 = StreamFilter(Gate=resample_curve_2, Stream0=toolpaths_2, Stream1=topoly_2.Polyline)
cp_2 = ControlPoints(Curve=filter_5)  # -> Points, Weights, Knots
rev_9 = ReverseList(List=cp_2.Points)
safe_z_height_4 = Number(safe_z_height_3)
item_9 = ListItem(List=cp_2.Points, Index=0, Wrap=True)
item_10 = ListItem(List=rev_9, Index=0, Wrap=True)
pdecon_4 = Deconstruct(Point=item_9)  # -> XComponent, YComponent, ZComponent
pdecon_5 = Deconstruct(Point=item_10)  # -> XComponent, YComponent, ZComponent
pt_6 = ConstructPoint(XCoordinate=pdecon_4.XComponent, YCoordinate=pdecon_4.YComponent, ZCoordinate=safe_z_height_4)
pt_7 = ConstructPoint(XCoordinate=pdecon_5.XComponent, YCoordinate=pdecon_5.YComponent, ZCoordinate=safe_z_height_4)

toolpath_points_3 = Point(cp_2.Points)
flatten_12 = FlattenTree(Tree=toolpath_points_3, Path="{0}")
lng_12 = ListLength(List=flatten_12)
feed_rate_4 = Number(feed_rate_3)
dup_13 = DuplicateData(Data=graft(feed_rate_4), Number=graft(lng_12), Order=True)
lng_13 = ListLength(List=toolpath_points_3)
dup_14 = DuplicateData(Data=flatten("F"), Number=flatten(lng_12), Order=True)
dup_15 = DuplicateData(Data=flatten(" X"), Number=flatten(lng_12), Order=True)
flatten_13 = FlattenTree(Tree=dup_14, Path="{0}")
flatten_14 = FlattenTree(Tree=dup_15, Path="{0}")
flatten_15 = FlattenTree(Tree=dup_13, Path="{0}")
pdecon_6 = Deconstruct(Point=toolpath_points_3)  # -> XComponent, YComponent, ZComponent
graft_15 = GraftTree(Tree=flatten_13, IncludeEmptyLists=True, IncludeNullItems=True)
graft_16 = GraftTree(Tree=flatten_15, IncludeEmptyLists=True, IncludeNullItems=True)
graft_17 = GraftTree(Tree=flatten_14, IncludeEmptyLists=True, IncludeNullItems=True)
panel_12 = Panel(pdecon_6.XComponent)
panel_13 = Panel(pdecon_6.YComponent)
panel_14 = Panel(pdecon_6.ZComponent)
join_8 = TextJoin(Text=[graft_15, graft_16, graft_17])
dup_16 = DuplicateData(Data=" Z", Number=lng_13, Order=True)
dup_17 = DuplicateData(Data=" Y", Number=lng_13, Order=True)
dup_18 = DuplicateData(Data="G1 ", Number=lng_13, Order=True)
simplify_11 = SimplifyTree(Tree=flatten(join_8), Front=False)
simplify_12 = SimplifyTree(Tree=flatten(dup_18), Front=False)
simplify_13 = SimplifyTree(Tree=flatten(panel_12), Front=False)
simplify_14 = SimplifyTree(Tree=flatten(dup_17), Front=False)
simplify_15 = SimplifyTree(Tree=flatten(panel_13), Front=False)
simplify_16 = SimplifyTree(Tree=flatten(dup_16), Front=False)
simplify_17 = SimplifyTree(Tree=flatten(panel_14), Front=False)
graft_18 = GraftTree(Tree=simplify_12, IncludeEmptyLists=True, IncludeNullItems=True)
graft_19 = GraftTree(Tree=simplify_13, IncludeEmptyLists=True, IncludeNullItems=True)
graft_20 = GraftTree(Tree=simplify_14, IncludeEmptyLists=True, IncludeNullItems=True)
graft_21 = GraftTree(Tree=simplify_15, IncludeEmptyLists=True, IncludeNullItems=True)
graft_22 = GraftTree(Tree=simplify_16, IncludeEmptyLists=True, IncludeNullItems=True)
graft_23 = GraftTree(Tree=simplify_17, IncludeEmptyLists=True, IncludeNullItems=True)
graft_24 = GraftTree(Tree=simplify_11, IncludeEmptyLists=True, IncludeNullItems=True)
join_9 = TextJoin(Text=[graft_18, graft_24, graft_19, graft_20, graft_21, graft_22, graft_23])
flatten_16 = FlattenTree(Tree=join_9, Path="{0}")
panel_15 = Panel(flatten_16)

# ---- group: Toolapths preview
safe_z_end_point_2 = Point(pt_7)
safe_z_start_point_2 = Point(pt_6)
# Rigth click and choose "Stream destination"
# 
# Give a file name ending with .gcode
# 
# Your toolpath will automatically be updated!
toolpath_points_4 = Point(flatten(cp_2.Points))
rev_10 = ReverseList(List=flatten(safe_z_end_point_2))
route_previvew_position_2 = Number(preview_position)
cull_i_3 = CullIndex(List=flatten(safe_z_start_point_2), Indices=0, Wrap=True)
lng_14 = ListLength(List=toolpath_points_4)
cull_i_4 = CullIndex(List=rev_10, Indices=0, Wrap=True)
rev_11 = ReverseList(List=flatten(cull_i_4))
number_slider_3 = Slider(3, range=0..10)
multiplication_13 = Multiplication(A=lng_14, B=route_previvew_position_2)
ln_4 = Line(StartPoint=safe_z_start_point_2, EndPoint=item_9)
ln_5 = Line(StartPoint=rev_11, EndPoint=cull_i_3)
ln_6 = Line(StartPoint=item_10, EndPoint=safe_z_end_point_2)
item_11 = ListItem(List=toolpath_points_4, Index=multiplication_13, Wrap=True)
toolpath_preview_line_2 = Curve(filter_5)
cut_transition_preview_line_2 = Curve(ln_5)
cut_entry_preview_line_2 = Curve(ln_4)
cut_exit_preview_line_2 = Curve(ln_6)
material_5 = CreateMaterial(
    Diffuse=ColourSwatch(SwatchColor=RGB(130, 249, 255)),
    Specular=RGB(255, 255, 255),
    Emission=RGB(0, 0, 0),
    Transparency=0,
    Shine=0)
material_6 = CreateMaterial(
    Diffuse=ColourSwatch(SwatchColor=RGB(99, 74, 16)),
    Specular=RGB(255, 255, 255),
    Emission=RGB(0, 0, 0),
    Transparency=0,
    Shine=0)
material_7 = CreateMaterial(
    Diffuse=ColourSwatch(SwatchColor=RGB(174, 234, 235)),
    Specular=RGB(255, 255, 255),
    Emission=RGB(0, 0, 0),
    Transparency=0,
    Shine=0)
material_8 = CreateMaterial(
    Diffuse=ColourSwatch(SwatchColor=RGB(77, 114, 115)),
    Specular=RGB(255, 255, 255),
    Emission=RGB(0, 0, 0),
    Transparency=0,
    Shine=0)
sph_2 = Sphere(Base=item_11, Radius=Slider(0.8, range=0..10))
preview_5 = CustomPreview(Geometry=toolpath_preview_line_2, Shader=material_5)
preview_6 = CustomPreview(Geometry=cut_transition_preview_line_2, Shader=material_6)
preview_7 = CustomPreview(Geometry=cut_entry_preview_line_2, Shader=material_7)
preview_8 = CustomPreview(Geometry=cut_exit_preview_line_2, Shader=material_8)

# ----
panel_16 = Panel(panel_15)

# ---- group: Code preview in viewport
number_of_code_preview_lines_2 = Slider(20, range=0..100)
code_preview_angle_2 = Slider(90, range=0..100)
code_preview_font_size_2 = Slider(3, range=0..100)
line_spacing_factor_2 = Slider(1.45, range=1..2.5)
pt_8 = ConstructPoint(XCoordinate=Slider(66, range=0..1000), YCoordinate=Slider(-8, range=-1000..1000), ZCoordinate=0)
multiplication_14 = Multiplication(A=code_preview_font_size_2, B=line_spacing_factor_2)
Y_3 = UnitY(Factor=1)
series_7 = Series(Start=0, Step=multiplication_14, Count=number_of_code_preview_lines_2)
rev_12 = Reverse(Vector=Y_3)
Z_3 = UnitZ(Factor=1)
split_2 = SplitList(List=panel_16, Index=number_of_code_preview_lines_2)  # -> ListA, ListB
neg_4 = Negative(Value=series_7)
pl_2 = ConstructPlane(Origin=pt_8, XAxis=rev_12, YAxis=Z_3)
series_8 = Series(Start=0, Step=Slider(1, range=0..1), Count=number_of_code_preview_lines_2)
dup_19 = DuplicateData(Data=code_preview_font_size_2, Number=number_of_code_preview_lines_2, Order=True)
division_4 = Division(A=series_8, B=number_of_code_preview_lines_2)
neg_5 = Negative(Value=code_preview_angle_2)
xz_2 = XZPlane(Origin=pt_8)
rev_13 = ReverseList(List=division_4)
rotate_2 = Rotate(Geometry=pl_2, Angle=degrees(neg_5), Plane=xz_2)  # -> Geometry, Transform
num_2 = Number(rev_13)
argb_2 = SplitARGB(Colour=ColourSwatch(SwatchColor=RGB(130, 232, 255)), IntegerChannels=True)  # -> Alpha, Red, Green, Blue
deplane_2 = DeconstructPlane(Plane=rotate_2.Geometry)  # -> Origin, XAxis, YAxis, ZAxis
amp_2 = Amplitude(Vector=deplane_2.YAxis, Amplitude=neg_4)
move_6 = Move(Geometry=rotate_2.Geometry, Motion=amp_2)  # -> Geometry, Transform
multiplication_15 = Multiplication(A=argb_2.Red, B=num_2)
multiplication_16 = Multiplication(A=argb_2.Blue, B=num_2)
multiplication_17 = Multiplication(A=argb_2.Green, B=num_2)
rgb_2 = ColourRGB(Alpha=255, Red=multiplication_15, Green=multiplication_17, Blue=multiplication_16)
tag_2 = TextTag3D(Location=xy_3, Text=split_2.ListA, Size=dup_19, Colour=rgb_2, Justification=1)

# ----
jog_rate_x_y_3 = Number(jog_rate_x_y_2)
item_12 = ListItem(List=pdecon_6.XComponent, Index=0, Wrap=True)
item_13 = ListItem(List=pdecon_6.YComponent, Index=0, Wrap=True)
int_3 = Integer(jog_rate_x_y_3)
lng_15 = ListLength(List=flatten(item_12))
safe_z_height_5 = Number(safe_z_height_3)
lng_16 = ListLength(List=flatten(item_12))
join_10 = TextJoin(Text=["F", int_3, " X"])
dup_20 = DuplicateData(Data="G0 ", Number=lng_15, Order=True)
dup_21 = DuplicateData(Data=" Y", Number=lng_15, Order=True)
dup_22 = DuplicateData(Data=" Z", Number=lng_15, Order=True)
dup_23 = DuplicateData(Data=safe_z_height_5, Number=lng_15, Order=True)
dup_24 = DuplicateData(Data=join_10, Number=lng_16, Order=True)
simplify_18 = SimplifyTree(Tree=flatten(dup_20), Front=False)
simplify_19 = SimplifyTree(Tree=flatten(item_12), Front=False)
simplify_20 = SimplifyTree(Tree=flatten(dup_21), Front=False)
simplify_21 = SimplifyTree(Tree=flatten(item_13), Front=False)
simplify_22 = SimplifyTree(Tree=flatten(dup_22), Front=False)
simplify_23 = SimplifyTree(Tree=flatten(dup_23), Front=False)
simplify_24 = SimplifyTree(Tree=flatten(dup_24), Front=False)
graft_25 = GraftTree(Tree=simplify_18, IncludeEmptyLists=True, IncludeNullItems=True)
graft_26 = GraftTree(Tree=simplify_24, IncludeEmptyLists=True, IncludeNullItems=True)
graft_27 = GraftTree(Tree=simplify_19, IncludeEmptyLists=True, IncludeNullItems=True)
graft_28 = GraftTree(Tree=simplify_20, IncludeEmptyLists=True, IncludeNullItems=True)
graft_29 = GraftTree(Tree=simplify_21, IncludeEmptyLists=True, IncludeNullItems=True)
graft_30 = GraftTree(Tree=simplify_22, IncludeEmptyLists=True, IncludeNullItems=True)
graft_31 = GraftTree(Tree=simplify_23, IncludeEmptyLists=True, IncludeNullItems=True)
join_11 = TextJoin(Text=[graft_25, graft_26, graft_27, graft_28, graft_29])
jog_rate_x_y_4 = Integer(jog_rate_x_y_3)
flatten_17 = FlattenTree(Tree=join_11, Path="{0}")
join_12 = TextJoin(Text=["F", jog_rate_x_y_4])
home_x_4 = Number(home_x_3)
home_y_4 = Number(home_y_3)
join_13 = TextJoin(Text=["G0 ", join_12, " X", home_x_4, " Y", home_y_4])
merge_4 = Merge(Data1=flatten(flatten_17), Data2=flatten(join_13))
jog_x_y_positions_2 = Panel(merge_4)

jog_rate_z_2 = Number(jog_rate_z)
int_4 = Integer(jog_rate_z_2)
safe_z_height_6 = Number(safe_z_height_3)
join_14 = TextJoin(Text=["F", int_4])
join_15 = TextJoin(Text=["G0 ", join_14, " Z", safe_z_height_6])
lng_17 = ListLength(List=merge_4)
dup_25 = DuplicateData(Data=join_15, Number=lng_17, Order=True)
flatten_18 = FlattenTree(Tree=dup_25, Path="{0}")
jog_z_positions = Panel(flatten_18)

# ---- group: Insert jog to safe Z
ma_2 = MassAddition(Input=flatten(lng_13))  # -> Result, PartialResults
merge_5 = Merge(Data1=Slider(0, range=0..100), Data2=ma_2.PartialResults)
ins_5 = InsertItems(List=flatten(panel_15), Item=flatten(jog_z_positions), Indices=flatten(merge_5), Wrap=True)

# ---- group: Insert jog X Y positions
lng_18 = ListLength(List=merge_5)
series_9 = Series(Start=1, Step=1, Count=lng_18)
addition_4 = Addition(A=merge_5, B=series_9)
ins_6 = InsertItems(List=flatten(ins_5), Item=flatten(jog_x_y_positions_2), Indices=flatten(addition_4), Wrap=True)

# ----
merge_6 = Merge(Data1=flatten(startcode_fabtotum), Data2=flatten(ins_6), Data3=flatten(endcode_fabtotum))
panel_17 = Panel(merge_6)
graft_32 = GraftTree(Tree=panel_17, IncludeEmptyLists=True, IncludeNullItems=True)
panel_18 = Panel(merge_6)
